# Dynamo graph Samples-Complex-CreateTask.dyn (Dynamo 1.3.0.875)

# note: Replace below with your Asana API key.
string = StringInput("Bearer xxxxxxxxxxxxxxxxxxxxxxxxxxxxxxxxxx")
client = Asana.Client.Client(string)
getAllProjects = Asana.Project.GetAllProjects(client)
firstItem = List.FirstItem(getAllProjects)
# note: This is the name of the project where the task will be created.
name = Asana.Project.Name(firstItem)
string_2 = StringInput("This is a test task from Dynamo")
string_3 = StringInput("Here you will find the long text description of the task. Feel free to write a novel here. Or maybe keep it short & to the point, your choice.")
# note: We are using the first Workspace & first Project returned by Asana in this sample, but feel free to supply your own (use the Get nodes for each).
getAllWorkspaces = Asana.Workspace.GetAllWorkspaces(client)
firstItem_2 = List.FirstItem(getAllWorkspaces)
# note: This will assign the task to whoever created the authorisation token.
getBySession = Asana.User.GetBySession(client)
# note: Not all fields are mandatory, assignee & tags are optional.
code_block = CodeBlock { null; }
task = Asana.Task.Task(string_2, string_3, firstItem_2, firstItem, getBySession, code_block)
createTask = Asana.Task.CreateTask(client, task)
name_2 = Asana.Task.Name(createTask)
# note: IDs are only allocated after Asana has created the task.
id = Asana.Task.Id(createTask)
notes = Asana.Task.Notes(createTask)
createdAt = Asana.Task.CreatedAt(createTask)
