# Dynamo graph Samples-Complex-GetTasksByProject.dyn (Dynamo 1.3.0.875)

# note: Replace below with your Asana API key.
string = StringInput("Bearer 0/xxxxxxxxxxxxxxxxxxxxxxxxxxxxxxxxxxxxxx")
client = Asana.Client.Client(string)
getWorkspaces = Asana.Client.GetWorkspaces(client)
firstItem = List.FirstItem(getWorkspaces)
id = Asana.Classes.Workspace.Id(firstItem)
getProjectsByWorkspace = Asana.Client.GetProjectsByWorkspace(client, id)
firstItem_2 = List.FirstItem(getProjectsByWorkspace)
id_2 = Asana.Classes.Project.Id(firstItem_2)
getTasksByProject = Asana.Client.GetTasksByProject(client, id_2)
notes = Asana.Classes.Task.Notes(getTasksByProject)
watch = Watch(notes)
name = Asana.Classes.Task.Name(getTasksByProject)
watch_2 = Watch(name)
# note: The integration returns Asana objects which need to be deconstructed to access their properties.
# Note : also works with DesignScript.
id_3 = Asana.Classes.Task.Id(getTasksByProject)
watch_3 = Watch(id_3)
createdAt = Asana.Classes.Task.CreatedAt(getTasksByProject)
watch_4 = Watch(createdAt)
code_block = CodeBlock(task=getTasksByProject) { task.Id; }
watch_5 = Watch(code_block)
projects = Asana.Classes.Task.Projects(getTasksByProject)
id_4 = Asana.Classes.Project.Id(projects)
watch_6 = Watch(id_4)
name_2 = Asana.Classes.Project.Name(projects)
watch_7 = Watch(name_2)
