# Dynamo graph Samples-GetTaskDetails.dyn (Dynamo 1.3.0.875)

string = StringInput("Bearer 0/7e47c745e9546e47b4f677926649db7d")
client = Asana.Client.Client(string)
string_2 = StringInput("314317576360056")
getTask = Asana.Client.GetTask(client, string_2)
id = Asana.Task.Id(getTask)
name = Asana.Task.Name(getTask)
customFields = Asana.Task.CustomFields(getTask)
name_2 = Asana.CustomField.Name(customFields)
value = Asana.CustomField.Value(customFields)
memberships = Asana.Task.Memberships(getTask)
project = Asana.Membership.Project(memberships)
name_3 = Asana.Project.Name(project)
section = Asana.Membership.Section(memberships)
name_4 = Asana.Section.Name(section)
tags = Asana.Task.Tags(getTask)
name_5 = Asana.Tag.name(tags)
getCurrentUser = Asana.Client.GetCurrentUser(client)
name_6 = Asana.User.Name(getCurrentUser)
email = Asana.User.Email(getCurrentUser)
