# Dynamo graph Samples-Simple-GetProjects.dyn (Dynamo 1.3.0.875)

# note: Replace below with your Asana API key.
string = StringInput("Bearer xxxxxxxxxxxxxxxxxxxxxxxxxxxxxxxxxxx")
client = Asana.Client.Client(string)
getAllWorkspaces = Asana.Workspace.GetAllWorkspaces(client)
# note: We are limiting results to first Workspace returned, but only for the purpose of this example.
firstItem = List.FirstItem(getAllWorkspaces)
id = Asana.Workspace.Id(firstItem)
# note: This node will only retrieve Projects that are part of the specified workspace.
getByWorkspace = Asana.Project.GetByWorkspace(client, id)
id_2 = Asana.Project.Id(getByWorkspace)
watch = Watch(id_2)
name = Asana.Project.Name(getByWorkspace)
watch_2 = Watch(name)
# note: This node however will retrieve all projects the user has access to, across all workspaces & organisations.
getAllProjects = Asana.Project.GetAllProjects(client)
name_2 = Asana.Project.Name(getAllProjects)
watch_3 = Watch(name_2)
