# Dynamo graph Samples-Simple-GetTasksByProject.dyn (Dynamo 1.3.0.875)

# note: Replace below with your Asana API key.
string = StringInput("Bearer xxxxxxxxxxxxxxxxxxxxxxxxxxxxxxxxxxxxxx")
client = Asana.Client.Client(string)
# note: Replace below with an Asana project ID. This can easily be found by looking at the middle portion of the URL in the browser when viewing a task in the Asana web application or using the GetProjects nodes.
string_2 = StringInput("207845234365369")
getByProject = Asana.Task.GetByProject(client, string_2)
name = Asana.Task.Name(getByProject)
watch = Watch(name)
# note: The integration returns Asana objects which need to be deconstructed to access their properties.
# Note : also works with DesignScript.
id = Asana.Task.Id(getByProject)
watch_2 = Watch(id)
code_block = CodeBlock(task=getByProject) { task.Id; }
watch_3 = Watch(code_block)
tags = Asana.Task.Tags(getByProject)
name_2 = Asana.Tag.Name(tags)
watch_4 = Watch(name_2)
notes = Asana.Task.Notes(getByProject)
watch_5 = Watch(notes)
