# Dynamo graph Samples-Complex-CreateTask.dyn (Dynamo 1.3.0.875)

# note: Replace below with your Asana API key.
string = StringInput("Bearer 0/xxxxxxxxxxxxxxxxxxxxxxxxxxxxxxxxxxxxxx")
client = Asana.Client.Client(string)
string_2 = StringInput("This is a test task from Dynamo")
string_3 = StringInput("Here you will find the long text description of the task. Feel free to write a novel here. Or maybe keep it short & to the point, your choice.")
# note: We are using the Id of the first Workspace returned by Asana in this sample, but feel free to supply your own Id.
getWorkspaces = Asana.Client.GetWorkspaces(client)
firstItem = List.FirstItem(getWorkspaces)
# note: Not all fields are mandatory.
code_block = CodeBlock { null; }
task = Asana.Classes.Task.Task(string_2, string_3, firstItem, code_block, code_block, code_block)
createTask = Asana.Client.CreateTask(client, task)
