# Dynamo graph Samples-Simple-GetProjects.dyn (Dynamo 1.3.0.875)

# note: Replace below with your Asana API key.
string = StringInput("Bearer xxxxxxxxxxxxxxxxxxxxxxxxxxxxxxxxxxx")
client = Asana.Client.Client(string)
getWorkspaces = Asana.Client.GetWorkspaces(client)
# note: We are limiting results to first Workspace returned, but only for the purpose of this example.
firstItem = List.FirstItem(getWorkspaces)
id = Asana.Classes.Workspace.Id(firstItem)
# note: This node will only retrieve Projects that are part of the specified workspace.
getProjectsByWorkspace = Asana.Client.GetProjectsByWorkspace(client, id)
id_2 = Asana.Classes.Project.Id(getProjectsByWorkspace)
watch = Watch(id_2)
name = Asana.Classes.Project.Name(getProjectsByWorkspace)
watch_2 = Watch(name)
# note: This node however will retrieve all projects the user has access to, across all workspaces & organisations.
getProjects = Asana.Client.GetProjects(client)
name_2 = Asana.Classes.Project.Name(getProjects)
watch_3 = Watch(name_2)
