# Dynamo graph Samples-Simple-GetTaskById.dyn (Dynamo 1.3.0.875)

# note: Replace below with your Asana API key.
string = StringInput("Bearer xxxxxxxxxxxxxxxxxxxxxxxxxxxxxxxxxxx")
# note: The client requires a string input, so you could alternatively use the "GetKeyFromXMLFile" node to read the key from an XML file saved on your computer.
# When deploying this in your organisation, it would be a good idea to save this file to a read-only location on your network and point to it in your scripts.
client = Asana.Client.Client(string)
# note: Replace number below with an Asana task ID. This can easily be found by looking at  the last portion of the URL in the browser when viewing a task in the Asana web application, or by selecting "Copy Task URL" from the task's menu.
string_2 = StringInput("299852053647462")
getTaskById = Asana.Client.GetTaskById(client, string_2)
notes = Asana.Classes.Task.Notes(getTaskById)
watch = Watch(notes)
name = Asana.Classes.Task.Name(getTaskById)
watch_2 = Watch(name)
# note: The integration returns Asana objects which need to be deconstructed to access their properties.
# Note : also works with DesignScript.
id = Asana.Classes.Task.Id(getTaskById)
watch_3 = Watch(id)
createdAt = Asana.Classes.Task.CreatedAt(getTaskById)
watch_4 = Watch(createdAt)
code_block = CodeBlock(task=getTaskById) { task.Id; }
watch_5 = Watch(code_block)
projects = Asana.Classes.Task.Projects(getTaskById)
id_2 = Asana.Classes.Project.Id(projects)
watch_6 = Watch(id_2)
name_2 = Asana.Classes.Project.Name(projects)
watch_7 = Watch(name_2)
tags = Asana.Classes.Task.Tags(getTaskById)
# note: Tag ID & Name are retrieved as part of the Task object, but any further Tag properties need to be retrieved using the GetTagByID node.
id_3 = Asana.Classes.Tag.Id(tags)
getTagById = Asana.Client.GetTagById(client, id_3)
createdAt_2 = Asana.Classes.Tag.CreatedAt(getTagById)
watch_8 = Watch(createdAt_2)
color = Asana.Classes.Tag.Color(getTagById)
watch_9 = Watch(color)
name_3 = Asana.Classes.Tag.Name(tags)
followers = Asana.Classes.Tag.Followers()  # unwired: arg0
