# Dynamo graph Samples-Simple-GetTasksByProject.dyn (Dynamo 1.3.0.875)

# note: Replace below with your Asana API key.
string = StringInput("Bearer 0/xxxxxxxxxxxxxxxxxxxxxxxxxxxxxxxxxxxxxx")
client = Asana.Client.Client(string)
# note: Replace below with an Asana project ID. This can easily be found by looking at the middle portion of the URL in the browser when viewing a task in the Asana web application or using the GetProjects nodes.
string_2 = StringInput("198900482693483")
getTasksByProject = Asana.Client.GetTasksByProject(client, string_2)
notes = Asana.Classes.Task.Notes(getTasksByProject)
watch = Watch(notes)
name = Asana.Classes.Task.Name(getTasksByProject)
watch_2 = Watch(name)
# note: The integration returns Asana objects which need to be deconstructed to access their properties.
# Note : also works with DesignScript.
id = Asana.Classes.Task.Id(getTasksByProject)
watch_3 = Watch(id)
createdAt = Asana.Classes.Task.CreatedAt(getTasksByProject)
watch_4 = Watch(createdAt)
code_block = CodeBlock(task=getTasksByProject) { task.Id; }
watch_5 = Watch(code_block)
projects = Asana.Classes.Task.Projects(getTasksByProject)
id_2 = Asana.Classes.Project.Id(projects)
watch_6 = Watch(id_2)
name_2 = Asana.Classes.Project.Name(projects)
watch_7 = Watch(name_2)
